# Grasshopper definition A1-test.gh (Grasshopper 1.0.7)

file_path = FilePath("C:\Users\m0o0\Dysk Google\MaCAD\3S3- GEOPT\GeoOpt\a01\test.py")
read_file = ReadFile(File=file_path, PerLineParse=False)
ghpython_script = GhPythonScript(Code=read_file)  # -> Out, A, B
panel = Panel(read_file)
data = Data(ghpython_script.B)
panel_2 = Panel(ghpython_script.Out)
panel_3 = Panel(data)
